# Grasshopper definition arduino_grasshopper_firefly.gh (Grasshopper 1.0.7)
# plug-ins: Firefly.Core

# Make sure the arduino has the "s02_arduino_serial_strings" sketch loaded and running.
open_communication = BooleanToggle(False)
number_slider = Slider(4, range=0..10)
turn_led_on = BooleanToggle(False)
p_n_c = PickNChoose(Pattern=turn_led_on, Stream0="off", Stream1="on")
trigger = Trigger(Interval=100, TimerInterval=100, Target=read)
open_port = OpenClosePort(OpenClosePort=open_communication, PortNumber=number_slider, BaudRate="9600")
read = SerialReadGeneric(StartReadingValues=open_communication, PortNumber=number_slider)  # -> SerialOutput, StatusMessage
write = SerialWriteGeneric(StartWritingValues=open_communication, WriteData=p_n_c, PortNumber=number_slider)  # -> ArduinoOutput, StatusMessage
panel = Panel(write.StatusMessage)
panel_2 = Panel(open_port)
panel_3 = Panel(write.ArduinoOutput)
panel_5 = Panel(read.SerialOutput)
