# Grasshopper definition http_get.gh (Grasshopper 1.0.7)
# plug-ins: jSwan

# ---- group: Get a text file that lives somewhere on a public URL. Double-click on the C# component to learn more.
http_get = CSharpScript(url="http://www.garciadelcastillo.es/simple-text-file.txt")  # -> out, response; inputs url: String
# ---------- http_get: C# usings ----------
using System.IO;
using System.Linq;
using System.Data;
using System.Drawing;
using System.Reflection;
using System.Windows.Forms;
using System.Xml;
using System.Xml.Linq;
using System.Runtime.InteropServices;

using Rhino.DocObjects;
using Rhino.Collections;
using GH_IO;
using GH_IO.Serialization;
# ---------- http_get: C# ----------
    if (url == null) return;

    System.Net.ServicePointManager.Expect100Continue = true;
    System.Net.ServicePointManager.SecurityProtocol = System.Net.SecurityProtocolType.Tls12; //the auth type

    var request = System.Net.WebRequest.Create(url);

    // If required by the server, set the credentials.
    request.Credentials = System.Net.CredentialCache.DefaultCredentials;

    // Get the response.
    var res = (System.Net.HttpWebResponse) request.GetResponse();

    // Display the status.
    Console.WriteLine(res.StatusDescription);

    // Get the stream containing content returned by the server.
    Stream dataStream = res.GetResponseStream();

    // Open the stream using a StreamReader for easy access.
    StreamReader reader = new StreamReader (dataStream);

    // Read the content.
    response = reader.ReadToEnd();

    reader.Close();
    dataStream.Close();
    res.Close();
# ---------- end http_get ----------
panel = Panel(http_get.response)

# ---- group: Web pages are also simple text files that get rendered by your browser, so can be downloaded as-is.
# http://gsd.harvard.edu
panel_2 = Panel("http://www.garciadelcastillo.es/simple-webpage.html")
http_get_2 = CSharpScript(url=panel_2)  # -> out, response; inputs url: String; same code as http_get
panel_3 = Panel(http_get_2.response)

# ---- group: Query the MBTA for information about the Harvard Square T stop
# Some URLs act more as "services" rather than serving static, text files. These are typically accessed through their API.
# For example, the Metropolitan Boston Transportation Authority has a service that allows you to retreive real-time information on their services through simple HTTP requests.
# The responses are also text, but structured as JSON objects to make them easier to parse for machines.
panel_4 = Panel("https://api-v3.mbta.com/stops/place-harsq")
http_get_3 = CSharpScript(url=panel_4)  # -> out, response; inputs url: String; same code as http_get

# ---- group: Query the MBTA for information about ARRIVALS to the Harvard Square T stop. Notice the additional query parameters in the URL.
panel_5 = Panel("https://api-v3.mbta.com/schedules?filter[min_time]=14:00&filter[max_time]=14:30&filter[stop]=place-harsq")
http_get_4 = CSharpScript(url=panel_5)  # -> out, response; inputs url: String; same code as http_get

# ---- group: Query LIFX for the state of your lights!
# Some of these services require that you create a developer account, and they give you an authentication token to verify your identity (sort of like your password).
# In this case, you just need to add an authorization header to the request
panel_6 = Panel("https://api.lifx.com/v1/lights/all")
http_get_auth = CSharpScript(url=panel_6, bearerToken="enter your auth token here")  # -> out, response; inputs url: String, bearerToken: String
# ---------- http_get_auth: C# ----------
    if (url == null) return;

    System.Net.ServicePointManager.Expect100Continue = true;
    System.Net.ServicePointManager.SecurityProtocol = System.Net.SecurityProtocolType.Tls12; //the auth type

    var request = System.Net.WebRequest.Create(url);

    // If required by the server, set the credentials.
    if (bearerToken.Length > 0)
    {
      request.PreAuthenticate = true;
      request.Headers.Add("Authorization", "Bearer " + bearerToken);
    }
    else
    {
      request.Credentials = System.Net.CredentialCache.DefaultCredentials;
    }
    
    // Get the response.
    var res = (System.Net.HttpWebResponse) request.GetResponse();

    // Display the status.
    Console.WriteLine(res.StatusDescription);

    // Get the stream containing content returned by the server.
    Stream dataStream = res.GetResponseStream();

    // Open the stream using a StreamReader for easy access.
    StreamReader reader = new StreamReader (dataStream);

    // Read the content.
    response = reader.ReadToEnd();

    reader.Close();
    dataStream.Close();
    res.Close();
# ---------- end http_get_auth ----------

# ----
panel_7 = Panel(http_get_auth.out)
panel_8 = Panel(http_get_auth.response)

# ---- group: Deserialize the main body of the JSON response
dejson = DeserializeJson(JSON=http_get_4.response, OutputsLocked=False)  # -> Data, Jsonapi
panel_9 = Panel(dejson.Data)
dejson_2 = DeserializeJson(JSON=dejson.Data, OutputsLocked=False)  # -> Attributes, Id, Relationships, Type
dejson_3 = DeserializeJson(JSON=dejson_2.Attributes, OutputsLocked=False)  # -> Arrival_time, Departure_time, Direction_id, Drop_off_type, Pickup_type, Stop_headsign, Stop_sequence, Timepoint
panel_10 = Panel(dejson_3.Arrival_time)

dejsonkv = DeserializeKeysAndValues(JSON=http_get_3.response, Keys="data")  # -> Key, Value
panel_11 = Panel(dejsonkv.Value)
dejsonkv_2 = DeserializeKeysAndValues(JSON=dejsonkv.Value, Keys="attributes")  # -> Key, Value

# ---- group: Get some potentially useful information
dejsonkv_3 = DeserializeKeysAndValues(JSON=dejsonkv_2.Value, Keys="address")  # -> Key, Value
dejsonkv_4 = DeserializeKeysAndValues(JSON=dejsonkv_2.Value, Keys="latitude")  # -> Key, Value
dejsonkv_5 = DeserializeKeysAndValues(JSON=dejsonkv_2.Value, Keys="longitude")  # -> Key, Value
panel_12 = Panel(dejsonkv_3.Value)
panel_13 = Panel(dejsonkv_4.Value)
panel_14 = Panel(dejsonkv_5.Value)
