# Grasshopper definition http_post.gh (Grasshopper 1.0.7)
# plug-ins: jSwan

# ---- group: Send a POST request with JSON content to a server that will bounce the same information back
panel = Panel("{\"name\":\"Jose Luis\",\"age\":18,\"height\":5.9,\"student\":false,\"languages\":[\"en\",\"es\",\"de\"],\"pet\":{\"name\":\"meeps\",\"type\":\"cat\",\"age\":4},\"parents\":[{\"name\":\"Jose Luis\",\"age\":70,\"type\":\"dad\"},{\"name\":\"Ana Maria\",\"age\":68,\"type\":\"mum\"}]}")
# POST requests send information attached to the request, to have the server store them or to customize the response.
panel_2 = Panel("http://httpbin.org/post")
http_post = CSharpScript(url=panel_2, JSONcontent=panel)  # -> out, response; inputs url: String, JSONcontent: String
# ---------- http_post: C# usings ----------
using System.Linq;
using System.Data;
using System.Drawing;
using System.Reflection;
using System.Windows.Forms;
using System.Xml;
using System.Xml.Linq;
using System.Runtime.InteropServices;

using System.Net;
using System.Text;  // for class Encoding
using System.IO;    // for StreamReader

using Rhino.DocObjects;
using Rhino.Collections;
using GH_IO;
using GH_IO.Serialization;
# ---------- http_post: C# ----------
    if (url == null) return;

    // From https://stackoverflow.com/a/4015346/1934487

    var request = (HttpWebRequest) WebRequest.Create(url);

    // Parameters can be added to the query URL
    //var postData = "thing1=" + Uri.EscapeDataString("hello");
    //postData += "&thing2=" + Uri.EscapeDataString("world");

    var data = Encoding.ASCII.GetBytes(JSONcontent);

    request.Method = "POST";
    request.ContentType = "application/json";
    request.ContentLength = data.Length;

    using (var stream = request.GetRequestStream())
    {
      stream.Write(data, 0, data.Length);
    }

    var res = (HttpWebResponse) request.GetResponse();

    var responseString = new StreamReader(res.GetResponseStream()).ReadToEnd();

    response = responseString;
# ---------- end http_post ----------

# ---- group: Deserialize the response
dejson = DeserializeJson(JSON=http_post.response, OutputsLocked=False)  # -> Args, Data, Files, Form, Headers, Json, Origin, Url
panel_3 = Panel(dejson.Json)
dejson_2 = DeserializeJson(JSON=dejson.Json, OutputsLocked=False)  # -> Age, Height, Languages, Name, Parents, Pet, Student
